# Grasshopper definition mh-optimization.gh (Grasshopper 1.0.7)

number_slider = Slider(43, range=0..100)
cantidad_de_capas = Slider(44, range=0..100)
radio_del_circulo = Slider(16, range=10..40)
altura_de_capa = Slider(0.44, range=0..1)
altura_de_capa_2 = Slider(0.85, range=0..1)
pt = ConstructPoint(XCoordinate=number_slider, YCoordinate=number_slider, ZCoordinate=0)
cir = Circle(Plane=pt, Radius=radio_del_circulo)
series = Series(Start=altura_de_capa, Step=altura_de_capa_2, Count=cantidad_de_capas)
Z = UnitZ(Factor=series)
move = Move(Geometry=cir, Motion=Z)  # -> Geometry, Transform

number_slider_2 = Slider(60, range=0..100)
cantidad_de_capas_2 = Slider(100, range=0..100)
altura_de_capa_3 = Slider(0.5, range=0..1)
altura_de_capa_4 = Slider(0.5, range=0..1)
radio_del_circulo_2 = Slider(25, range=10..40)
pt_2 = ConstructPoint(XCoordinate=number_slider_2, YCoordinate=number_slider_2, ZCoordinate=0)
series_2 = Series(Start=altura_de_capa_3, Step=altura_de_capa_4, Count=cantidad_de_capas_2)
cir_2 = Circle(Plane=pt_2, Radius=radio_del_circulo_2)
Z_2 = UnitZ(Factor=series_2)
range = Range(Domain=Domain(0, 1), Steps=expr("x-1", cantidad_de_capas_2))
move_2 = Move(Geometry=cir_2, Motion=Z_2)  # -> Geometry, Transform
graph = GraphMapper(range, x0=0, x1=1, y0=0, y1=1, container_name="Sine", Equation_px=[0, 0.8424363732], Equation_py=[0.6991202831, 1])
area = Area(Geometry=move_2.Geometry)  # -> Area, Centroid
scale = Scale(Geometry=move_2.Geometry, Center=area.Centroid, Factor=graph)  # -> flatten(Geometry), Transform
dom = ConstructDomain(DomainStart=0, DomainEnd=Slider(6, range=0..10))
remap = RemapNumbers(Value=graph, Source=Domain(0, 1), Target=dom)  # -> graft(Mapped), Clipped
multiplication = Multiplication(A=Slider(31, range=0..100), B=2)
pframes = PerpFrames(Curve=scale.Geometry, Count=multiplication, Align=True)  # -> Frames, Parameters
neg = Negative(Value=remap.Mapped)
pt_3 = PointOriented(BasePlane=pframes.Frames, UComponent=remap.Mapped, VComponent=0, WComponent=0)
pt_4 = PointOriented(BasePlane=pframes.Frames, UComponent=neg, VComponent=0, WComponent=0)
weave = Weave(Pattern=[0, 1, 1, 0], Stream0=pt_3, Stream1=pt_4, NullGaps=False)
intcrv = Interpolate(Vertices=weave, Degree=3, Periodic=invert(False), KnotStyle=1)  # -> flatten(Curve), Length, Domain

number_slider_3 = Slider(44, range=0..100)
cantidad_de_capas_3 = Slider(100, range=0..100)
cantidad_de_texturas = Slider(29, range=0..100)
largo_de_las_texturas = Slider(7, range=0..10)
altura_de_capa_5 = Slider(0.5, range=0..1)
altura_de_capa_6 = Slider(0.5, range=0..1)
radio_del_circulo_3 = Slider(28, range=10..40)
pt_5 = ConstructPoint(XCoordinate=number_slider_3, YCoordinate=number_slider_3, ZCoordinate=0)
series_3 = Series(Start=altura_de_capa_5, Step=altura_de_capa_6, Count=cantidad_de_capas_3)
cir_3 = Circle(Plane=pt_5, Radius=radio_del_circulo_3)
Z_3 = UnitZ(Factor=series_3)
range_2 = Range(Domain=Domain(0, 1), Steps=expr("x-1", cantidad_de_capas_3))
move_3 = Move(Geometry=cir_3, Motion=Z_3)  # -> Geometry, Transform
graph_2 = GraphMapper(
    range_2,
    x0=0,
    x1=1,
    y0=0,
    y1=1,
    container_name="Sine",
    Equation_px=[0.1877046078, 0.7262961864],
    Equation_py=[0.8869087696, 0.4928172827])
area_2 = Area(Geometry=move_3.Geometry)  # -> Area, Centroid
dom_2 = ConstructDomain(DomainStart=0, DomainEnd=largo_de_las_texturas)
scale_2 = Scale(Geometry=move_3.Geometry, Center=area_2.Centroid, Factor=graph_2)  # -> flatten(Geometry), Transform
remap_2 = RemapNumbers(Value=graph_2, Source=Domain(0, 1), Target=dom_2)  # -> Mapped, Clipped
dispatch = Dispatch(List=remap_2.Mapped, DispatchPattern=[True, False])  # -> ListA, ListB
neg_2 = Negative(Value=dispatch.ListB)
neg_3 = Negative(Value=dispatch.ListA)
multiplication_2 = Multiplication(A=cantidad_de_texturas, B=2)
weave_2 = Weave(Pattern=[0, 1], Stream0=dispatch.ListA, Stream1=neg_3, NullGaps=False)  # -> graft(Weave)
weave_3 = Weave(Pattern=[0, 1], Stream0=neg_2, Stream1=dispatch.ListB, NullGaps=False)  # -> graft(Weave)
pframes_2 = PerpFrames(Curve=scale_2.Geometry, Count=multiplication_2, Align=True)  # -> Frames, Parameters
pt_6 = PointOriented(BasePlane=pframes_2.Frames, UComponent=weave_2, VComponent=0, WComponent=0)
pt_7 = PointOriented(BasePlane=pframes_2.Frames, UComponent=weave_3, VComponent=0, WComponent=0)
weave_4 = Weave(Pattern=[0, 1, 1, 0], Stream0=pt_6, Stream1=pt_7, NullGaps=False)
intcrv_2 = Interpolate(Vertices=weave_4, Degree=3, Periodic=invert(False), KnotStyle=1)  # -> flatten(Curve), Length, Domain
panel = Panel("""0
0
0
0
1""")
lng = ListLength(List=intcrv_2.Curve)
repeat = RepeatData(Data=panel, Length=lng)
p_n_c = PickNChoose(Pattern=repeat, Stream0=scale_2.Geometry, Stream1=intcrv_2.Curve)

number_slider_4 = Slider(60, range=0..100)
cantidad_de_capas_4 = Slider(57, range=0..100)
radio_del_circulo_4 = Slider(14, range=10..40)
altura_de_capa_7 = Slider(0.5, range=0..1)
altura_de_capa_8 = Slider(0.5, range=0..1)
pt_8 = ConstructPoint(XCoordinate=number_slider_4, YCoordinate=number_slider_4, ZCoordinate=0)
cir_4 = Circle(Plane=pt_8, Radius=radio_del_circulo_4)
series_4 = Series(Start=altura_de_capa_7, Step=altura_de_capa_8, Count=cantidad_de_capas_4)
Z_4 = UnitZ(Factor=series_4)
range_3 = Range(Domain=Domain(0, 1), Steps=expr("x-1", cantidad_de_capas_4))
move_4 = Move(Geometry=cir_4, Motion=Z_4)  # -> Geometry, Transform
graph_3 = GraphMapper(
    range_3,
    x0=0,
    x1=1,
    y0=0,
    y1=1,
    container_name="Sine",
    Equation_px=[0.5577003956, 0.8986788392],
    Equation_py=[0.3318939209, 0.8943606615])
area_3 = Area(Geometry=move_4.Geometry)  # -> Area, Centroid
scale_3 = Scale(Geometry=move_4.Geometry, Center=area_3.Centroid, Factor=graph_3)  # -> Geometry, Transform

espacio_de_trabajo = Geometry(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)
geo = Geometry(move.Geometry)
geo_2 = Geometry(scale_3.Geometry)
geo_3 = Geometry(intcrv.Curve)
geo_4 = Geometry(p_n_c)

number_slider_5 = Slider(43, range=0..100)
altura_de_la_ultima_capa = Slider(26.6, range=0..40)
altura_de_la_primera_capa = Slider(0.3, range=0..1)
radio_del_circulo_5 = Slider(22, range=10..40)
altura_de_capa_9 = Slider(0.7, range=0..1)
pt_9 = ConstructPoint(XCoordinate=number_slider_5, YCoordinate=number_slider_5, ZCoordinate=0)
cir_5 = Circle(Plane=pt_9, Radius=radio_del_circulo_5)
Z_5 = UnitZ(Factor=altura_de_la_primera_capa)
Z_6 = UnitZ(Factor=altura_de_la_ultima_capa)
division = Division(A=altura_de_la_ultima_capa, B=altura_de_capa_9)
move_5 = Move(Geometry=cir_5, Motion=Z_5)  # -> Geometry, Transform
move_6 = Move(Geometry=cir_5, Motion=Z_6)  # -> Geometry, Transform
range_4 = Range(Domain=Domain(0, 1), Steps=division)
tweencrv = TweenCurve(CurveA=move_5.Geometry, CurveB=move_6.Geometry, Factor=range_4, BlendType=0)

number_slider_6 = Slider(42, range=0..100)
altura_de_capa_10 = Slider(0.4, range=0..1)
altura_de_la_ultima_capa_2 = Slider(22.2, range=0..40)
altura_de_la_primera_capa_2 = Slider(0.4, range=0..1)
radio_del_circulo_6 = Slider(15, range=10..40)
pt_10 = ConstructPoint(XCoordinate=number_slider_6, YCoordinate=number_slider_6, ZCoordinate=0)
multiplication_3 = Multiplication(A=altura_de_capa_10, B=0.7)
division_2 = Division(A=altura_de_la_ultima_capa_2, B=multiplication_3)
cir_6 = Circle(Plane=pt_10, Radius=radio_del_circulo_6)
Z_7 = UnitZ(Factor=altura_de_la_primera_capa_2)
Z_8 = UnitZ(Factor=altura_de_la_ultima_capa_2)
move_7 = Move(Geometry=cir_6, Motion=Z_7)  # -> Geometry, Transform
move_8 = Move(Geometry=cir_6, Motion=Z_8)  # -> Geometry, Transform
range_5 = Range(Domain=Domain(0, 1), Steps=division_2)
range_6 = Range(Domain=Domain(0, 1), Steps=expr("15", 15))
divide = DivideCurve(Curve=move_8.Geometry, Count=32, Kinks=False)  # -> Points, Tangents, Parameters
dom_3 = ConstructDomain(DomainStart=0, DomainEnd=10)
graph_4 = GraphMapper(
    range_6,
    x0=0,
    x1=1,
    y0=0,
    y1=1,
    container_name="Sine",
    Equation_px=[0.02021095902, 0.4034465551],
    Equation_py=[0.599714756, 0.9099453688])
remap_3 = RemapNumbers(Value=graph_4, Source=Domain(0, 1), Target=dom_3)  # -> Mapped, Clipped
rev = ReverseList(List=remap_3.Mapped)
merge = Merge(Data1=remap_3.Mapped, Data2=rev)
apertura = Slider(22, range=0..100)
Z_9 = UnitZ(Factor=merge)
move_9 = Move(Geometry=divide.Points, Motion=Z_9)  # -> Geometry, Transform
series_5 = Series(Start=Slider(5, range=0..10), Step=1, Count=apertura)
item = ListItem(List=move_9.Geometry, Index=series_5, Wrap=True)
lng_2 = ListLength(List=range_5)
intcrv_3 = Interpolate(Vertices=item, Degree=3, Periodic=False, KnotStyle=1)  # -> Curve, Length, Domain
range_7 = Range(Domain=Domain(0, 1), Steps=expr("x-1", lng_2))
tweencrv_2 = TweenCurve(CurveA=move_7.Geometry, CurveB=intcrv_3.Curve, Factor=range_5, BlendType=0)
graph_5 = GraphMapper(
    range_7,
    x0=0,
    x1=1,
    y0=0,
    y1=1,
    container_name="Sine",
    Equation_px=[0.02252336033, 0.6672723889],
    Equation_py=[0.497908175, 1])
bbox = BoundingBox(Content=tweencrv_2, Plane=PlaneXY(0, 0, 0))  # -> Box, Box_2
volume = Volume(Geometry=bbox.Box)  # -> Volume, Centroid
scale_nu = ScaleNU(Geometry=tweencrv_2, Plane=volume.Centroid, ScaleX=graph_5, ScaleY=graph_5, ScaleZ=1)  # -> Geometry, Transform
dispatch_2 = Dispatch(List=scale_nu.Geometry, DispatchPattern=[True, False])  # -> ListA, ListB
flip = FlipCurve(Curve=dispatch_2.ListB)  # -> Curve, Flag
weave_5 = Weave(Pattern=[0, 1], Stream0=dispatch_2.ListA, Stream1=flip.Curve, NullGaps=False)

number_slider_7 = Slider(43, range=0..100)
altura_de_capa_11 = Slider(0.4, range=0..1)
altura_de_la_ultima_capa_3 = Slider(16.3, range=0..40)
altura_de_la_primera_capa_3 = Slider(0.3, range=0..1)
radio_del_circulo_7 = Slider(17, range=10..40)
pt_11 = ConstructPoint(XCoordinate=number_slider_7, YCoordinate=number_slider_7, ZCoordinate=0)
multiplication_4 = Multiplication(A=altura_de_capa_11, B=0.7)
division_3 = Division(A=altura_de_la_ultima_capa_3, B=multiplication_4)
cir_7 = Circle(Plane=pt_11, Radius=radio_del_circulo_7)
Z_10 = UnitZ(Factor=altura_de_la_primera_capa_3)
Z_11 = UnitZ(Factor=altura_de_la_ultima_capa_3)
move_10 = Move(Geometry=cir_7, Motion=Z_10)  # -> Geometry, Transform
move_11 = Move(Geometry=cir_7, Motion=Z_11)  # -> Geometry, Transform
range_8 = Range(Domain=Domain(0, 1), Steps=division_3)
range_9 = Range(Domain=Domain(0, 1), Steps=expr("15", 15))
divide_2 = DivideCurve(Curve=move_11.Geometry, Count=32, Kinks=False)  # -> Points, Tangents, Parameters
dom_4 = ConstructDomain(DomainStart=0, DomainEnd=10)
graph_6 = GraphMapper(range_9, x0=0, x1=1, y0=0, y1=1, container_name="Sine", Equation_px=[0, 0.2853702307], Equation_py=[1, 0.4576305151])
remap_4 = RemapNumbers(Value=graph_6, Source=Domain(0, 1), Target=dom_4)  # -> Mapped, Clipped
rev_2 = ReverseList(List=remap_4.Mapped)
merge_2 = Merge(Data1=remap_4.Mapped, Data2=rev_2)
Z_12 = UnitZ(Factor=merge_2)
move_12 = Move(Geometry=divide_2.Points, Motion=Z_12)  # -> Geometry, Transform
lng_3 = ListLength(List=range_8)
intcrv_4 = Interpolate(Vertices=move_12.Geometry, Degree=3, Periodic=invert(False), KnotStyle=1)  # -> Curve, Length, Domain
range_10 = Range(Domain=Domain(0, 1), Steps=expr("x-1", lng_3))
tweencrv_3 = TweenCurve(CurveA=move_10.Geometry, CurveB=intcrv_4.Curve, Factor=range_8, BlendType=0)
graph_7 = GraphMapper(
    range_10,
    x0=0,
    x1=1,
    y0=0,
    y1=1,
    container_name="Sine",
    Equation_px=[0, 0.3791434467],
    Equation_py=[0.7441378832, 0.9779607654])
bbox_2 = BoundingBox(Content=tweencrv_3, Plane=PlaneXY(0, 0, 0))  # -> Box, Box_2
volume_2 = Volume(Geometry=bbox_2.Box)  # -> Volume, Centroid
scale_nu_2 = ScaleNU(Geometry=tweencrv_3, Plane=volume_2.Centroid, ScaleX=graph_7, ScaleY=graph_7, ScaleZ=1)  # -> Geometry, Transform

number_slider_8 = Slider(43, range=0..100)
altura_de_la_primera_capa_4 = Slider(0.3, range=0..1)
altura_de_la_ultima_capa_4 = Slider(26.6, range=0..40)
radio_del_circulo_8 = Slider(22, range=10..40)
altura_de_capa_12 = Slider(0.3, range=0..1)
pt_12 = ConstructPoint(XCoordinate=number_slider_8, YCoordinate=number_slider_8, ZCoordinate=0)
cir_8 = Circle(Plane=pt_12, Radius=radio_del_circulo_8)
Z_13 = UnitZ(Factor=altura_de_la_primera_capa_4)
Z_14 = UnitZ(Factor=altura_de_la_ultima_capa_4)
division_4 = Division(A=altura_de_la_ultima_capa_4, B=altura_de_capa_12)
move_13 = Move(Geometry=cir_8, Motion=Z_13)  # -> Geometry, Transform
move_14 = Move(Geometry=cir_8, Motion=Z_14)  # -> Geometry, Transform
range_11 = Range(Domain=Domain(0, 1), Steps=division_4)
range_12 = Range(Domain=Domain(0, 1), Steps=expr("15", 15))
divide_3 = DivideCurve(Curve=move_14.Geometry, Count=32, Kinks=False)  # -> Points, Tangents, Parameters
dom_5 = ConstructDomain(DomainStart=0, DomainEnd=Slider(10, range=0..10))
graph_8 = GraphMapper(
    range_12,
    x0=0,
    x1=1,
    y0=0,
    y1=1,
    container_name="Sine",
    Equation_px=[0.08200655878, 0.3691680431],
    Equation_py=[0.3842246532, 0.9570076466])
remap_5 = RemapNumbers(Value=graph_8, Source=Domain(0, 1), Target=dom_5)  # -> Mapped, Clipped
rev_3 = ReverseList(List=remap_5.Mapped)
merge_3 = Merge(Data1=remap_5.Mapped, Data2=rev_3)
Z_15 = UnitZ(Factor=merge_3)
move_15 = Move(Geometry=divide_3.Points, Motion=Z_15)  # -> Geometry, Transform
intcrv_5 = Interpolate(Vertices=move_15.Geometry, Degree=3, Periodic=invert(False), KnotStyle=1)  # -> Curve, Length, Domain
tweencrv_4 = TweenCurve(CurveA=move_13.Geometry, CurveB=intcrv_5.Curve, Factor=range_11, BlendType=0)

geo_5 = Geometry(tweencrv)
geo_6 = Geometry(tweencrv_4)
geo_7 = Geometry(scale_nu_2.Geometry)
relay = Relay()
geo_8 = Geometry(weave_5)

relación_de_impresión = Slider(0.7, range=0.5..1.5)
distancia_entre_puntos = Slider(0.16, range=0..1)
divlength = DivideLength(Curve=relay, Length=distancia_entre_puntos)  # -> Points, Tangents, Parameters
multiplication_5 = Multiplication(A=distancia_entre_puntos, B=relación_de_impresión)
lng_4 = ListLength(List=divlength.Points)
pdecon = Deconstruct(Point=flatten(divlength.Points))  # -> XComponent, YComponent, ZComponent
merge_4 = Merge(Data1=Slider(2000, range=0..10000), Data2=Slider(800, range=0..10000))
repeat_2 = RepeatData(Data=multiplication_5, Length=lng_4)
replace = ReplaceItems(List=repeat_2, Item="0", Indices="0", Wrap=False)
ma = MassAddition(Input=flatten(replace))  # -> Result, PartialResults
concatenate = Concatenate(
    J="G1 F",
    K=merge_4,
    Fragment_A=" X",
    Fragment_B=pdecon.XComponent,
    B=" Y",
    C=pdecon.YComponent,
    E=" Z",
    F=pdecon.ZComponent,
    H=" E")  # -> flatten(Result)
inicio_impresora_pla = Panel("""; Ender 3 V2 - Custom Start G-code modificado para Grasshopper
M140 S60 ; Calentar cama a 60°C 
M104 S220 ; Calentar hotend a 220°C
M190 S60 ; Esperar a que la cama alcance 60°C
M109 S200 ; Esperar a que el hotend alcance 200°C
G92 E0 ; Resetear extrusor
G28 ; Home en todos los ejes
G1 Z2.0 F3000 ; Subir Z ligeramente para evitar rayar la cama
G1 X0.1 Y20 Z0.3 F5000.0 ; Mover al inicio
G1 X0.1 Y200.0 Z0.3 F1500.0 E15 ; Dibujar línea inicial
G1 X0.4 Y200.0 Z0.3 F5000.0 ; Mover un poco al lado
G1 X0.4 Y20 Z0.3 F1500.0 E30 ; Segunda línea
G92 E0 ; Reset extrusor
G1 Z2.0 F3000 ; Subir Z un poco
G1 X5 Y20 Z0.3 F5000.0 ; Mover para evitar acumulación de material""")
end_impresora_pla = Panel("""G91 ; Posicionamiento relativo
G1 E-2 F2700 ; Retracción del filamento
G1 E-2 Z0.2 F2400 ; Retracción extra y levantar un poco Z
G1 X5 Y5 F3000 ; Mover boquilla para limpiar
G1 Z10 F1200 ; Elevar más el eje Z
G90 ; Posicionamiento absoluto
G1 X0 Y200 F3000 ; Mover cama al frente (ajusta el Y si tu cama no tiene 200mm)
M106 S0 ; Apagar ventilador de capa
M104 S0 ; Apagar hotend
M140 S0 ; Apagar cama
M84 ; Desactivar todos los motores (desactiva X, Y, Z y E)""")

pline = PolyLine(Vertices=flatten(divlength.Points), Closed=False)
merge_5 = Merge(Data1="0", Data2=ma.PartialResults)

concatenate_2 = Concatenate(FragmentA=graft(concatenate), FragmentB=graft(merge_5))  # -> flatten(Result)
merge_6 = Merge(Data1=inicio_impresora_pla, Data2=flatten(concatenate_2), Data3=end_impresora_pla)
panel_2 = Panel(merge_6)
